% Simulink data dictionary Model_Vars.sldd

accelBias = [0.09 0.09 0.09]
dt = 0.005
gyroBias = [0.005 0.005 0.005]
IMU_Rate = 1000

K = [1.470249 6.079113e-16 3.35429e-16 1.780005e-18 -9.946226e-05 -7.133563e-19 1.698931e-16 -0.198962 -7.14015e-17 0.1384902 3.41134e-17 1.695942e-16
 3.47313e-15 1.470249 -2.079564e-15 9.946226e-05 -1.645091e-17 -1.419498e-17 0.198962 -5.543074e-16 9.617835e-17 3.46339e-17 0.1384902 6.91463e-16
 -6.747766e-14 5.713105e-14 1.265573e-14 -3.979402e-17 -7.457944e-18 0.004559014 7.592308e-15 9.58408e-17 11.39805 -4.249235e-15 4.352528e-15 4.867908e-15
 -5.425011e-15 -2.596143e-14 5.065571 2.448453e-17 -6.53605e-17 -5.934759e-17 -1.116608e-14 -1.218548e-16 -3.126767e-16 -3.486942e-15 2.246843e-15 3.781954]

windMerid = 2.29163
windZonal = 4.031552

constantsASTRA = struct(
  m=1.275,
  l=0.5,
  g=9.80145,
  rTB=0.26,
  J=[0.067 0 0; 0 0.067 0; 0 0 0.02],
  T=0.01,
  mag=[1; 0; 0],
  Q=[1.5e-07 0 0 0 0 0 0 0 0 -1.25e-14 -0 -0 0 0 0 0 0 0
   0 1.5e-07 0 0 0 0 0 0 0 -0 -1.25e-14 -0 0 0 0 0 0 0
   0 0 1.5e-07 0 0 0 0 0 0 -0 -0 -1.25e-14 0 0 0 0 0 0
   0 0 0 4.166667e-10 0 0 1.25e-07 0 0 0 0 0 -2.083333e-20 -0 -0 0 0 0
   0 0 0 0 4.166667e-10 0 0 1.25e-07 0 0 0 0 -0 -2.083333e-20 -0 0 0 0
   0 0 0 0 0 4.166667e-10 0 0 1.25e-07 0 0 0 -0 -0 -2.083333e-20 0 0 0
   0 0 0 1.25e-07 0 0 5e-05 0 0 0 0 0 -1.25e-17 -0 -0 0 0 0
   0 0 0 0 1.25e-07 0 0 5e-05 0 0 0 0 -0 -1.25e-17 -0 0 0 0
   0 0 0 0 0 1.25e-07 0 0 5e-05 0 0 0 -0 -0 -1.25e-17 0 0 0
   -1.25e-14 -0 -0 0 0 0 0 0 0 5e-12 0 0 0 0 0 0 0 0
   -0 -1.25e-14 -0 0 0 0 0 0 0 0 5e-12 0 0 0 0 0 0 0
   -0 -0 -1.25e-14 0 0 0 0 0 0 0 0 5e-12 0 0 0 0 0 0
   0 0 0 -1.25e-17 -0 -0 -2.083333e-20 -0 -0 0 0 0 5.0e-15 0 0 0 0 0
   0 0 0 -0 -1.25e-17 -0 -0 -2.083333e-20 -0 0 0 0 0 5.0e-15 0 0 0 0
   0 0 0 -0 -0 -1.25e-17 -0 -0 -2.083333e-20 0 0 0 0 0 5.0e-15 0 0 0
   0 0 0 0 0 0 0 0 0 0 0 0 0 0 0 5.0e-18 0 0
   0 0 0 0 0 0 0 0 0 0 0 0 0 0 0 0 5.0e-18 0
   0 0 0 0 0 0 0 0 0 0 0 0 0 0 0 0 0 5.0e-18],
  R=[0.06 0 0 0 0 0
   0 0.06 0 0 0 0
   0 0 0.06 0 0 0
   0 0 0 0.002 0 0
   0 0 0 0 0.002 0
   0 0 0 0 0 0.002],
  BSigma=0.05,
  BBias=1.0e-8,
  MaxT=16.63306065)

magDistMatrix = [1 0 0; 0 1 0; 0 0 1]
x0 = [1; 0; 0; 0; 0; 0; 0; 0; 0; 0; 0; 0; 0; 20.78; 19.79]

slBus1 = Simulink.Bus()
  m_dry: double
  g: double
  rTB: double
  J: double[3 3]
  MaxThrust: double
  MaxMdot: double
  OF: double
  OxMass: double
  FuMass: double
  OxHeight: double
  FuHeight: double
  OxRadius: double
  FuRadius: double
  Ox_Z: double
  Fu_Z: double
  m_wet: double
  Q: double[18 18]
  R: double[6 6]
  BSigma: double
  BBias: double
  mag: double[3 1]
  K_Att: double[3 9]

u0 = [0; 0; 1696.337; 0]
HoldTimeReqs = [20 10 2 3]
Checkpoints = [0 5 5 5; 0 5 10 10; 0 50 0 0]
distMode = 0.004
Sig = Simulink.Signal()
Sig1 = Simulink.Signal()